# Grasshopper definition TG_OF.gh (Grasshopper 1.0.7)

ladybug = Ladybug_Ladybug()  # -> Vviiiiiiiiiizzz; plug-in component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
honeybee = Honeybee_Honeybee()  # -> Vviiiiiiiiiizzz; plug-in component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
panel = Panel("C:\Users\tgerrish\Documents\GitHub\climate\tests\weatherfile.epw")
gencumulativeskymtx = Ladybug_GenCumulativeSkyMtx(epwFile=panel, skyDensity="1", useOldRes=True, runIt=Toggle(True))  # -> readMe, cumulativeSkyMtx; plug-in component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
number_slider = Slider(5580, range=0..8759)

# ---- group: All hours
panel_2 = Panel("8760")  # disabled
series = Series(Start=0, Step=1, Count=panel_2)  # disabled
selectskymtx = Ladybug_selectSkyMtx(cumulativeSkyMtx=gencumulativeskymtx.cumulativeSkyMtx, HOY=graft(series), removeDiffuse=False, removeDirect=False)  # -> readMe, simplify(selectedSkyMtx); disabled; plug-in component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

# ----
hoy = LadybugPlus_CalculateHOY(month="8", day="21", hour="12", minute=0)  # -> hoy, doy, date; plug-in component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
importgroundtemp = Ladybug_ImportGroundTemp(epwFile=panel)  # -> readMe, groundtemp1st, groundtemp2nd, groundtemp3rd, profileCrvs, crvColors, graphAxes, graphtext, Legend; plug-in component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
selectskymtx_2 = Ladybug_selectSkyMtx(cumulativeSkyMtx=gencumulativeskymtx.cumulativeSkyMtx, HOY=number_slider, removeDiffuse=False, removeDirect=False)  # -> readMe, selectedSkyMtx; plug-in component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
importepwcustom = LadybugPlus_ImportEPWCustom(epwFile=panel, HOY=number_slider)  # -> dryBulbTemperature, dewPointTemperature, relativeHumidity, windSpeed, windDirection, totalSkyCover, horizontalIR, datetimeString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; inputs HOY: Int32
#   port epwFile: An .epw file path on your system as a string.
# ---------- importepwcustom: Python ----------
ghenv.Component.Name = "LadybugPlus_Import EPW Custom"
ghenv.Component.NickName = 'importEpwCustom'
ghenv.Component.Message = 'v0 TG'

import datetime

try:
    import ladybug.epw as epw
    import ladybug.output as output
except ImportError:
    raise ImportError('\nFailed to import ladybug:\n\t{}'.format(e))

epw_data = epw.EPW(_epwFile)
dryBulbTemperature = [float(i) for i in epw_data.dry_bulb_temperature.values][_HOY-1]
dewPointTemperature = [float(i) for i in epw_data.dew_point_temperature.values][_HOY-1]
relativeHumidity = [float(i) for i in epw_data.relative_humidity.values][_HOY-1]
windDirection = [float(i) for i in epw_data.wind_direction.values][_HOY-1]
windSpeed = [float(i) for i in epw_data.wind_speed.values][_HOY-1]
totalSkyCover = [float(i)/10 for i in epw_data.total_sky_cover.values][_HOY-1]
horizontalIR = [float(i) for i in epw_data.horizontal_infrared_radiation_intensity.values][_HOY-1]

def suffix(d):
    return 'th' if 11<=d<=13 else {1:'st',2:'nd',3:'rd'}.get(d%10, 'th')

def custom_strftime(format, t):
    return t.strftime(format).replace('{S}', str(t.day) + suffix(t.day))

start = datetime.datetime(2018, 1, 1)
dts = []
for i in range(8760):
    dts.append(start)
    start += datetime.timedelta(hours=1)

datetime = dts[_HOY - 1]
datetimeString = custom_strftime('%B {S} %H:%M', dts[_HOY - 1])
month = dts[_HOY - 1].month
day = dts[_HOY - 1].day
hour = dts[_HOY - 1].hour
# ---------- end importepwcustom ----------
strnum = Ladybug_SeparateData(inputList=flatten(importgroundtemp.groundtemp1st))  # -> numbers, strings; plug-in component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
panel_3 = Panel(importepwcustom.datetimeString)
subtraction = Subtraction(A=importepwcustom.month, B="1")
item = ListItem(List=strnum.numbers, Index=subtraction, Wrap=True)
reinhartskydomepatchcentroids = Point([Point(0, 0.9974743617, 0.05405619598), Point(0.104264463, 0.9920100868, 0.05405619662), Point(0.2073865797, 0.9756771554, 0.05405619563), Point(0.3082365279, 0.9486544907, 0.05405619689), Point(0.4057093711, 0.9112381587, 0.05405619587), Point(0.4987371821, 0.8638381327, 0.05405619395)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])
dewpointtemperature = Data(importepwcustom.dewPointTemperature)
drybulbtemperature = Data(importepwcustom.dryBulbTemperature)
groundtemperature = Data(item)
relativehumidity = Data(importepwcustom.relativeHumidity)
totalskycover = Data(importepwcustom.totalSkyCover)
horizontalir = Data(importepwcustom.horizontalIR)
windspeed = Data(importepwcustom.windSpeed)
windspeedcalculator = Ladybug_WindSpeedCalculator(windSpeed_tenMeters=windspeed, terrainType="2")  # -> readMe, windSpeedAtHeight, windVectorAtHeight; plug-in component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
rectangle = Rectangle(Plane=PlaneXY(0, 0, 0), XSize="-1000 to 1000", YSize="-1000 to 1000", Radius=0)  # -> Rectangle, Length

# ---- group: Sky Radiation modelling and horizontal infrared radaition intensity
se_ir = Translation(dryBulbTemperature=drybulbtemperature, dewpointTemperature=dewpointtemperature, totalSkyCover=totalskycover)  # -> skyEmissivity, horizontalIR
# ---------- se_ir: Python ----------
ghenv.Component.Name = "Translation"
ghenv.Component.NickName = 'Se & IR'
ghenv.Component.Message = 'v0 TG'

"""
EnergyPlus calculates the Horizontal Infrared Radiation Intensity in Wh/m2, if it is missing on the weather file or for design days, from the Opaque Sky Cover field as shown in the following explanation.

HorizontalIR=Skyemissivity⋅Sigma⋅Temperature drybulb**4
"""

import math

# Temperature in Kelvin
_dewpointTemperature = _dewpointTemperature + 273.15

# Calculate Sky Emissivity (source unknonw)
skyEmissivity = (0.787 + 0.764 * math.log(_dewpointTemperature / 273.15)) * (1 + 0.0224 * _totalSkyCover - 0.0035 * _totalSkyCover ** 2 + 0.0028 * _totalSkyCover ** 3)

#http://bigladdersoftware.com/epx/docs/8-4/engineering-reference/climate-calculations.html
stefanBoltzmannConstant = 5.6697E-8
_dryBulbTemperature = _dryBulbTemperature + 273.15
horizontalIR = skyEmissivity * stefanBoltzmannConstant * _dryBulbTemperature ** 4
# ---------- end se_ir ----------

# ----
boundary = BoundarySurfaces(Edges=rectangle.Rectangle)
context = Data(boundary)
windspeed_2 = Data(windspeedcalculator.windSpeedAtHeight)
pt = Point(Point(0, 0, 1.5))
list = ValueList({"Stucco (Very Rough)": 0, "Brick (Rough)": 1, "Concrete (Medium Rough)": 2, "Clear pine (Medium Smooth)": 3, "Smooth Plaster(Smooth)": 4, "Glass (Very Smooth)": 5}, selected="Concrete (Medium Rough)")
floor_albedo = Slider(0.2, range=0..1)
cube = Cube(Value=relativehumidity)
remap = RemapNumbers(Value=cube, Source="0 to 1.0E+6", Target="0.33 to 1.4")  # -> Mapped, Clipped
# Materials surface 	Thermal emissivity
# Aluminum foil 	0.03
# Asphalt 	0.88
# Brick 	0.90
# Concrete, rough 	0.91
# Glass, smooth (uncoated) 	0.91
# Limestone 	0.92
# Marble, polished or white 	0.89 to 0.92
# Marble, smooth 	0.56
# Paper, roofing or white 	0.88 to 0.86
# Plaster, rough 	0.89
# Silver, polished 	0.02
number_slider_2 = Slider(0.6, range=0..1)
number_slider_3 = Slider(0.8, range=0..1)
# 1,1 Solar adjustment tool
# 1,8 NV
# Furb→p=(A1/A2)Fp→urb
human_area = Slider(1.2, range=0..10)

dis_sph = GhPythonScript(selectedSkyMtx=selectskymtx_2.selectedSkyMtx, density="1000")  # -> totalRadiationPatchValues, diffuseRadiationPatchValues, directRadiationPatchValues, vec, alt, sky; inputs selectedSkyMtx: list, density: Int32
# ---------- dis_sph: Python ----------
import rhinoscriptsyntax as rs
from System import Object
from Grasshopper import DataTree
from Grasshopper.Kernel.Data import GH_Path
import math
import ghpythonlib.components as ghp

#_density=1000

def chunks(lst, n):
    """Yield successive n-sized chunks from lst."""
    for i in range(0, len(lst), n):
        yield lst[i:i + n]

def lb_split(listy):
    num = []
    str = []
    lastOne = None
    strPath = 0
    numPath = 0
    numbers = DataTree[Object]()
    strings = DataTree[Object]()
    for count, item in enumerate(listy):
        try:
            item = float(item)
            if count == 0: numfirst = True
            if lastOne == None: lastOne = "float"
            if lastOne!= "float":
                lastOne = "float"
                numPath += 1
            if numfirst == False:
                p = GH_Path(numPath-1)
                numbers.Add(item, p)
            else:
                p = GH_Path(numPath)
                numbers.Add(item, p)
        except:
            if count == 0: 
                numfirst = False
            if lastOne == None: 
                lastOne = "str"
            if lastOne!= "str":
                lastOne = "str"
                strPath += 1
            if numfirst == True:
                p = GH_Path(strPath-1)
                strings.Add(item, p)
            else:
                p = GH_Path(strPath)
                strings.Add(item, p)
    return strings, numbers

def dis_sphere(N=100):
    vectors = []
    TETA=[]
    SKY=[]
    offset = 2 / N
    increment = math.pi * (3 - math.sqrt(5));
    for i in range(N):
        y = ((i * offset) - 1) + (offset / 2);
        r = math.sqrt(1 - y ** 2)
        phi = i  * increment
        x = math.cos(phi) * r
        z = math.sin(phi) * r
        Teta=math.atan(z / math.sqrt(x ** 2 + y ** 2))
        Teta=math.fabs(Teta)
        TETA.append(Teta)
        vec=rs.VectorUnitize([x, y, z])
        vectors.append(vec)
        if z>0:
            SKY.append("True")
        else:
            SKY.append("False")
    return vectors, TETA, SKY

# Split the input list into separate parts
a, b, c = list(chunks(_selectedSkyMtx, 584))
totalRadiationPatchValues = lb_split(a)[1]
diffuseRadiationPatchValues = lb_split(b)[1]
directRadiationPatchValues = lb_split(c)[1]

vec=dis_sphere(_density)[0]
alt=dis_sphere(_density)[1]
sky=dis_sphere(_density)[2]

print(_density)
# ---------- end dis_sph ----------
conv_heat = PythonScript(va=windspeed_2, i=list)  # -> hc
# ---------- conv_heat: Python ----------
"""
Convective Heat Transfer for air
http://bigladdersoftware.com/epx/docs/8-0/engineering-reference/page-020.html
The roughness correlation is taken from Figure 1, Page 22.4, ASHRAE Handbook of Fundamentals (ASHRAE 1989).

hc = D+E*va+F*va**2 

hc = heat transfer coefficient
Va = local wind speed calculated at the height above ground of the surface centroid
D, E, F = material roughness coefficients
"""
Material=["Stucco (Very Rough)","Brick (Rough)",'Concrete (Medium Rough)','Clear pine (Medium Smooth)','Smooth Plaster(Smooth) ','Glass (Very Smooth)' ]
D=[11.58,12.49,10.79,8.23,10.22,8.23]
E=[5.89,4.065,4.192,4,3.1,3.33]
F=[0,0.028,0,-0.057,0,-0.036]

hc = D[i]+E[i]*va+F[i]*va**2
mt=Material[i]
# ---------- end conv_heat ----------
# Atmospheric Radiation
ir_sky = PythonScript(Skyemissivity=se_ir.skyEmissivity, HorizontalIR=horizontalir)  # -> flatten(TotalSky)
# ---------- ir_sky: Python ----------
SVF=1
TotalSky=Skyemissivity*HorizontalIR*SVF
# ---------- end ir_sky ----------

cps = ClosestPoints(Point=dis_sph.vec, Cloud=reinhartskydomepatchcentroids, Count=3)  # -> ClosestPoint, simplify(CPIndex), Distance
vec = Data(dis_sph.vec)
alt = Data(dis_sph.alt)
sky = Data(dis_sph.sky)

nvalue = PythonScript(vec=dis_sph.vec, Rad=dis_sph.totalRadiationPatchValues, item=cps.CPIndex, Dis=cps.Distance)  # -> NValue; inputs vec: list, Rad: list, item: tree, Dis: tree
# ---------- nvalue: Python ----------
import scriptcontext as sc
def main(Rad):
    NValue=[]
    for i in range(len(vec)):
        b=[]
        m=[]
        for j in range(len(item.Branch(0))):
            c=Dis.Branch(i)[j]
            m.append(c)
            b.append(Rad[item.Branch(i)[j]]*c)
        d=sum(b)/sum(m)
        NValue.append(d)
    NNV=[]
    for n in range (len(NValue)):
        if vec[n].Z<=0:
            NNV.append(0)
        else:
            NNV.append(NValue[n])
    NValue=NNV
    Rad=sum(Rad)
    SNValue=sum(NValue)
    NNV=[]
    for n in NValue:
        if n!=0:
            NNV.append(n/SNValue*Rad)
        else:NNV.append(0)
    return NNV

NValue = main(Rad)
# ---------- end nvalue ----------
raytrace = PythonScript(startPts=pt, startVectors=vec, context=flatten(context))  # -> lastVector, PtList, LenInt; inputs startPts: list of Point3d, startVectors: list of Vector3d, context: list
# ---------- raytrace: Python ----------
#this component is custumized based on Ladybug "bounceFromSurface"
# 
# Copyright (c) 2013-2018, Mostapha Sadeghipour Roudsari <mostapha@ladybug.tools> 
# Ladybug is free software; you can redistribute it and/or modify 
# it under the terms of the GNU General Public License as published 
# by the Free Software Foundation; either version 3 of the License, 
# or (at your option) any later version. 
# 
# Ladybug is distributed in the hope that it will be useful,
# but WITHOUT ANY WARRANTY; without even the implied warranty of 
# MERCHANTABILITY or FITNESS FOR A PARTICULAR PURPOSE. See the 
# GNU General Public License for more details.
# 
# You should have received a copy of the GNU General Public License
# along with Ladybug; If not, see <http://www.gnu.org/licenses/>.
# 
# @license GPL-3.0+ <http://spdx.org/licenses/GPL-3.0+>
from clr import AddReference
#AddReference('Grasshopper')
import Grasshopper.Kernel as gh
import Rhino as rc
import rhinoscriptsyntax as rs
import scriptcontext as sc
from Grasshopper import DataTree
from Grasshopper.Kernel.Data import GH_Path


def raggedListToDataTree(raggedList):
    rl = raggedList
    result = DataTree[object]()
    for i in range(len(rl)):
        temp = []
        for j in range(len(rl[i])):
            temp.append(rl[i][j])
        #print i, " - ",temp
        path = GH_Path(i)
        result.AddRange(temp, path)
    return result


def main(startPts, startVectors, context, numOfBounce):
    if sc.sticky.has_key('ladybug_release'):
        lb_preparation = sc.sticky["ladybug_Preparation"]()
        lb_mesh = sc.sticky["ladybug_Mesh"]()
        lb_runStudy_GH = sc.sticky["ladybug_RunAnalysis"]()
        lb_visualization = sc.sticky["ladybug_ResultVisualization"]()
    # A failed attampt to use mesh instead of brep so the component could work with trimmed surfaces
    if len(context)!=0:
        contextMesh, contextBrep = lb_preparation.cleanAndCoerceList(context)
        contextMeshedBrep = lb_mesh.parallel_makeContextMesh(contextBrep)
        contextMeshedBrep = lb_preparation.flattenList(contextMeshedBrep)
        contextSrfs = contextMesh + contextMeshedBrep
        joinedContext = lb_mesh.joinMesh(contextSrfs)
    cleanBrep = rc.Geometry.Brep.CreateFromMesh(joinedContext, False)
    
    FList=[]
    LVector=[]
    LPts=[]
    for testPt in startPts:
        FL=[]
        PtsList=[]
        LastVector=[]
        LenPts=[]
        for vector in startVectors:
            vector.Unitize()
            ray = rc.Geometry.Ray3d(testPt, vector)
            FirstPts = rc.Geometry.Intersect.Intersection.RayShoot(ray, [cleanBrep], 1)
            FL.append(FirstPts)
            if numOfBounce>0:
                intPts = rc.Geometry.Intersect.Intersection.RayShoot(ray, [cleanBrep], numOfBounce)
                if intPts:
                    ptList = [testPt]
                    ptList.extend(intPts)
                    try:
                        # creat last vector
                        intNormal = cleanBrep.ClosestPoint(intPts[-1], sc.doc.ModelAbsoluteTolerance)[5]
                        lastVector = rc.Geometry.Vector3d(ptList[-2] - ptList[-1])
                        lastVector.Unitize()
                        crossProductNormal = rc.Geometry.Vector3d.CrossProduct(intNormal, lastVector)
                        plane = rc.Geometry.Plane(intPts[-1], intNormal, crossProductNormal)
                        mirrorT = rc.Geometry.Transform.Mirror(intPts[-1], plane.Normal)
                        lastVector.Transform(mirrorT)
                    except:
                        pass
                        
                else:
                    # no bounce so let's just create a Vec form the point
                    lastVector=vector
                    ptList=[]
                LastVector.append(lastVector)
                #PtsList.append(ptList)
                ptlen=len(ptList)
                if ptlen==0: LenPts.append(0)
                else: LenPts.append(ptlen-1)
        #PList.append(PtsList)
        FList.append(FL)
        LVector.append(LastVector)
        LPts.append(LenPts)
    return LVector,LPts,FList



R= main(_startPts, _startVectors, _context, 2)

lastVector=raggedListToDataTree(R[0])

LenInt=raggedListToDataTree(R[1]) #lenght of intersected points

#remove # to calculate the list of intersection
PtList=raggedListToDataTree(R[2])
# ---------- end raytrace ----------
python_script = PythonScript(alt=alt, sky=sky)  # -> Fp; inputs alt: list, sky: list of Boolean
# ---------- python_script: Python ----------
# Calculate the view factor between a Human body and direct sunlight
# If seated: Fp ≈ 0.25

import math

Fp=[]
if not az:
    az = (math.pi) / 4 # 45 degrees

for i in range(len(alt)):
    if sky[i]:
        al=alt[i]
        fp=0.0355*math.sin(al)+2.33*math.cos(al)*math.sqrt(0.0213*(math.cos(az)**2)+0.0091*(math.sin(az)**2))
    else: 
        fp=0
    Fp.append(fp)
# ---------- end python_script ----------

nvalues = Data(nvalue)
panel_4 = Panel(python_script)
cp = ClosestPoint(Point=raytrace.lastVector, Cloud=vec)  # -> ClosestPoint, CPIndex, Distance
panel_5 = Panel(cp.CPIndex)

ein = PythonScript(Fp=python_script, Nvalues=nvalues, item=cp.CPIndex)  # -> simplify(Ein); inputs Fp: list, Nvalues: list, item: list
# ---------- ein: Python ----------
Ein=[]
for i in item:
    Ein.append(Fp[i]*Nvalues[i])
# ---------- end ein ----------
ein_out = PythonScript(Ein=ein, LenInt=raytrace.LenInt, Albedo=floor_albedo)  # -> simplify(Eout); inputs Ein: list, LenInt: list
# ---------- ein_out: Python ----------
Eout=[]
for i in range(len(LenInt)):
    Eout.append((Albedo**LenInt[i])*Ein[i]*1000)
Eout=sum(Eout)
# ---------- end ein_out ----------
m2_total_radiation = TotalRadiationOn1m2(Alt=alt, NVv=nvalues, sky=sky)  # -> a; inputs Alt: list, NVv: list, sky: list of Boolean
# ---------- m2_total_radiation: Python ----------
ghenv.Component.Name = "Total radiation on 1m2"
ghenv.Component.NickName = 'm2 total radiation'
ghenv.Component.Message = 'v0 TG'

import math
A=[]
B=[]
for i in range(len(Alt)):
    if _sky[i]== True:
        A.append(Alt[i])
        B.append(NVv[i])
C=[]
for i in range(len(A)):
    C.append(math.sin(A[i])*B[i])
    
a=sum(C)*1000
# ---------- end m2_total_radiation ----------
surface_temperature = PythonScript(
    absorptivity=number_slider_2,
    emissivity=number_slider_3,
    tickness=Slider(1, range=0..1),
    k=remap.Mapped,
    Ein=m2_total_radiation,
    Tin=groundtemperature,
    Ta=drybulbtemperature,
    hc=conv_heat)  # -> flatten(Ts)
# ---------- surface_temperature: Python ----------
import math
d=5.67*(10**(-8))

"""
Convective Heat Transfer for air
http://www.engineeringtoolbox.com/convective-heat-transfer-d_430.html
The convective heat transfer coefficient of air is approximately equal to 
hc = 10.45-v+10*v**(1/2)    (2)
v = the relative speed of the object through the air (m/s)
Note! - this is an empirical equation and can be used for velocities - v - from 2 to 20 m/s.
"""

"""
Emissivity = Absorptivity at a particular wavelength (and direction for “non-diffuse” surfaces). 
In the case of a surface receiving radiation and emitting radiation there is no reason why these 
two values should be the same. This is because the incident radiation will be at one wavelength 
(or range of wavelengths), but the wavelength of emission depends on the temperature of the surface.
"""

"""
The equation for convection can be expressed as:
q = hc A dT        
q = heat transferred per unit time (W)
A = heat transfer area of the surface (m2)
hc= convective heat transfer coefficient of the process (W/(m2K) or W/(m2oC))
dT = temperature difference between the surface and the bulk fluid (K or oC)

Heat Transfer Coefficients - Units
    1 W/(m2K) = 0.85984 kcal/(h m2 oC) = 0.1761 Btu/(ft2 h oF)
    1 Btu/(ft2 h oF) = 5.678 W/(m2 K) = 4.882 kcal/(h m2 oC)
    1 kcal/(h m2 oC) = 1.163 W/(m2K) = 0.205 Btu/(ft2 h oF)
    
http://www.engineersedge.com/heat_transfer/convection_heat_transfer.htm
"""

Tin=Tin+273.15
Ta=Ta+273.15
a=emissivity*d
b=k/tickness+hc
c=-(k*Tin/tickness+Ein*absorptivity+hc*Ta)

Ts=[]
nnn=[]
try: 
    X = 1/2 *math.sqrt((4*(2/3)**(1/3)*c)/(math.sqrt(3)*math.sqrt(27*a**2*b**4-256*a**3*c**3)+9*a*b**2)**(1/3)+(math.sqrt(3)*math.sqrt(27*a**2*b**4-256*a**3*c**3)+9*a*b**2)**(1/3)/(2**(1/3)*3**(2/3)*a))-1/2*math.sqrt(-(2*b)/(a *math.sqrt((4* (2/3)**(1/3)*c)/(math.sqrt(3)*math.sqrt(27 *a**2 *b**4-256* a**3* c**3)+9*a*b**2)**(1/3)+(math.sqrt(3)*math.sqrt(27*a**2*b**4-256*a**3*c**3)+9*a*b**2)**(1/3)/(2**(1/3)*3**(2/3)*a)))-(math.sqrt(3)*math.sqrt(27*a**2*b**4-256*a**3*c**3)+9*a*b**2)**(1/3)/(2**(1/3)*3**(2/3)*a)-(4*(2/3)**(1/3)*c)/(math.sqrt(3)*math.sqrt(27*a**2* b**4-256* a**3*c**3)+9*a*b**2)**(1/3))
    if 0 < X:
        Ts.append(X)
except: 
    nnn.append(1)

try:
    X = 1/2 *math.sqrt((4*(2/3)**(1/3)*c)/(math.sqrt(3)*math.sqrt(27*a**2*b**4-256*a**3*c**3)+9*a*b**2)**(1/3)+(math.sqrt(3)*math.sqrt(27*a**2*b**4-256*a**3*c**3)+9*a*b**2)**(1/3)/(2**(1/3)*3**(2/3)*a))+1/2*math.sqrt(-(2*b)/(a*math.sqrt((4*(2/3)**(1/3)*c)/(math.sqrt(3)*math.sqrt(27*a**2*b**4-256*a**3*c**3)+9*a*b**2)**(1/3)+(math.sqrt(3)*math.sqrt(27*a**2*b**4-256*a**3*c**3)+9*a*b**2)**(1/3)/(2**(1/3)*3**(2/3)*a)))-(math.sqrt(3)*math.sqrt(27*a**2*b**4-256*a**3*c**3)+9*a*b**2)**(1/3)/(2**(1/3)*3**(2/3)*a)-(4*(2/3)**(1/3)*c)/(math.sqrt(3)*math.sqrt(27*a**2*b**4-256*a**3*c**3)+9*a*b**2)**(1/3)) 
    if 0 < X:
        Ts.append(X)
except: 
    nnn.append(2)

try: 
    X =-1/2 *math.sqrt((4*(2/3)**(1/3)*c)/(math.sqrt(3)*math.sqrt(27*a**2*b**4-256*a**3*c**3)+9*a*b**2)**(1/3)+(math.sqrt(3)*math.sqrt(27*a**2*b**4-256*a**3*c**3)+9*a*b**2)**(1/3)/(2**(1/3)*3**(2/3)*a))-1/2*math.sqrt((2*b)/(a*math.sqrt((4*(2/3)**(1/3)*c)/(math.sqrt(3)*math.sqrt(27*a**2*b**4-256*a**3*c**3)+9*a*b**2)**(1/3)+(math.sqrt(3)*math.sqrt(27*a**2*b**4-256*a**3*c**3)+9*a*b**2)**(1/3)/(2**(1/3)*3**(2/3)*a)))-(math.sqrt(3)*math.sqrt(27*a**2*b**4-256*a**3*c**3)+9*a*b**2)**(1/3)/(2**(1/3)*3**(2/3)*a)-(4*(2/3)**(1/3)*c)/(math.sqrt(3)*math.sqrt(27*a**2*b**4-256*a**3*c**3)+9*a*b**2)**(1/3))
    if 0 < X:
        Ts.append(X)
except: 
    nnn.append(3)
    print(3)

try:
    X = 1/2 *math.sqrt((2*b)/(a*math.sqrt((4*(2/3)**(1/3)*c)/(math.sqrt(3)*math.sqrt(27*a**2*b**4-256*a**3*c**3)+9*a*b**2)**(1/3)+(math.sqrt(3)*math.sqrt(27*a**2*b**4-256*a**3*c**3)+9*a*b**2)**(1/3)/(2**(1/3)*3**(2/3)*a)))-(math.sqrt(3)*math.sqrt(27*a**2*b**4-256*a**3*c**3)+9*a*b**2)**(1/3)/(2**(1/3)*3**(2/3)*a)-(4*(2/3)**(1/3)*c)/(math.sqrt(3)*math.sqrt(27*a**2*b**4-256*a**3*c**3)+9*a*b**2)**(1/3))-1/2*math.sqrt((4*(2/3)**(1/3)*c)/(math.sqrt(3)*math.sqrt(27*a**2*b**4-256*a**3*c**3)+9*a*b**2)**(1/3)+(math.sqrt(3)*math.sqrt(27*a**2*b**4-256*a**3*c**3)+9*a*b**2)**(1/3)/(2**(1/3)*3**(2/3)*a))
    if 0 < X:
        Ts.append(X)
except: 
    nnn.append(4)
    print(4)

Tsc=[]
for i in Ts:
    Tsc.append(i-273)

Eout=[]
for i in Ts:
    E=a*(i**4)
    Eout.append(E)
# ---------- end surface_temperature ----------
# Solar Radiation
esol = PythonScript(Esol=ein_out)  # -> flatten(TotalSol)
# ---------- esol: Python ----------
σ= 5.6697*10**(-8)
ap=0.7
if Esol:
    TotalSol=ap*Esol
else: TotalSol=0
# ---------- end esol ----------
# Ground Radiation
ε_ts_4_furb = PythonScript(Ts=surface_temperature, ε=number_slider_3, A1=human_area)  # -> R, flatten(SR); inputs Ts: list
# ---------- ε_ts_4_furb: Python ----------
#Eurb = σ.ε.Ts**4
#Floor Fv= 0.4
σ= 5.6697*10**(-8)
R=[]
A2=1
for t in Ts:
    if t:
        a=(A1/A2)  *   ε   *   (σ*ε*t**4)   *    .4
        R.append(a)
SR=sum(R)
# ---------- end ε_ts_4_furb ----------
tmrt = PythonScript(TotalSky=ir_sky, TotalSol=esol, SR=ε_ts_4_furb.SR)  # -> Tmrt; inputs TotalSky: list, TotalSol: list, SR: list
# ---------- tmrt: Python ----------
σ= 5.6697*10**(-8)
Tmrt=[]
for i in range(len(SR)):
    mrt=     (((TotalSky[i]+TotalSol[i]+SR[i]))/σ)**(0.25)-273.15
    Tmrt.append(mrt)
# ---------- end tmrt ----------

panel_6 = Panel(tmrt)
